# Grasshopper definition test.gh (Grasshopper 1.0.7)

number_slider = Slider(2, range=0..2)
path = FilePath("C:\Users\danil\OneDrive\Documents\Github\colidescope\os_server\rhino\MovedSphere.json")
path_2 = FilePath("C:\Users\danil\OneDrive\Documents\Github\colidescope\os_server\rhino\Move.json")
path_3 = FilePath("C:\Users\danil\OneDrive\Documents\Github\colidescope\os_server\rhino\Sphere.json")
path_4 = FilePath("C:\Users\danil\OneDrive\Documents\Github\colidescope\os_server\rhino\Box.json")
file = ReadFile(File=path, PerLineParse=False)
vec = VectorXYZ(XComponent=number_slider, YComponent=number_slider, ZComponent=number_slider)  # -> Vector, Length
file_2 = ReadFile(File=path_2, PerLineParse=False)
file_3 = ReadFile(File=path_3, PerLineParse=False)
file_4 = ReadFile(File=path_4, PerLineParse=False)
python = GhPythonScript(script=file)  # -> out, G
# ---------- python: Python ----------
import helpers
reload(helpers)

outputs = helpers.run_script(helpers.process_script(script, globals()))

G = filter( lambda x: x["name"] == "G", outputs )[0]["value"]
# ---------- end python ----------
python_2 = GhPythonScript(script=file_3)  # -> out, S
# ---------- python_2: Python ----------
import helpers
reload(helpers)

outputs = helpers.run_script(helpers.process_script(script, globals()))

S = filter( lambda x: x["name"] == "S", outputs )[0]["value"]
# ---------- end python_2 ----------
python_3 = GhPythonScript(script=file_2, geo=python_2.S)  # -> out, G; inputs geo: Brep; same code as python
sph = Sphere(Base=PlaneXY(0, 0, 0), Radius=1)
panel = Panel(file_3)
box = CenterBox(Base=PlaneXY(0, 0, 0), X=1, Y=1, Z=1)
panel_2 = Panel(file_4)
python_4 = GhPythonScript(script=file_4)  # -> out, B
# ---------- python_4: Python ----------
import helpers
reload(helpers)

outputs = helpers.run_script(helpers.process_script(script, globals()))

B = filter( lambda x: x["name"] == "B", outputs )[0]["value"]
# ---------- end python_4 ----------
move = Move(Geometry=python_2.S, Motion=vec.Vector)  # -> Geometry, Transform
panel_3 = Panel(file)
panel_4 = Panel(file_2)
